# Grasshopper definition Workshop (1).gh (Grasshopper 0.9.76)
# plug-ins: TT Toolbox

# ---- group: ReadExcel
read_excel_sheet = ReadExcelSheet(Run=Toggle(True), Worksheet="Sheet1", Listen=False)  # -> UserMessages, Columns, Rows

# ---- group: Latitude
list_item = ListItem(List=read_excel_sheet.Rows, Index=Slider(0, range=0..100), Wrap=True)  # -> flatten(Item)
cull_index = CullIndex(List=list_item, Indices=Slider(0, range=0..100), Wrap=True)
radians = Radians(Degrees=cull_index)

# ---- group: Longitude
list_item_2 = ListItem(List=read_excel_sheet.Rows, Index=Slider(1, range=0..100), Wrap=True)  # -> flatten(Item)
cull_index_2 = CullIndex(List=list_item_2, Indices=Slider(0, range=0..100), Wrap=True)
radians_2 = Radians(Degrees=cull_index_2)

# ---- group: Wind
list_item_3 = ListItem(List=read_excel_sheet.Rows, Index=Slider(2, range=0..100), Wrap=True)  # -> flatten(Item)
cull_index_3 = CullIndex(List=list_item_3, Indices=Slider(0, range=0..100), Wrap=True)
c_script = CSharpScript(x=flatten(cull_index_3))  # -> out, A; inputs x: String
# ---------- c_script: C# ----------
    string ou = x;

    if( ou == "" ) ou = "1";

    double inte = System.Convert.ToDouble(ou);

    A = ou;
# ---------- end c_script ----------
bounds = Bounds(Numbers=c_script.A)
construct_domain = ConstructDomain(DomainStart=0, DomainEnd=Slider(255, range=0..1000))
remap_numbers = RemapNumbers(Value=c_script.A, Source=bounds, Target=construct_domain)  # -> Mapped, Clipped

# ---- group: Temperature
list_item_4 = ListItem(List=read_excel_sheet.Rows, Index=Slider(3, range=0..100), Wrap=True)  # -> flatten(Item)
cull_index_4 = CullIndex(List=list_item_4, Indices=Slider(0, range=0..100), Wrap=True)
c_script_2 = CSharpScript(x=flatten(cull_index_4))  # -> out, A; inputs x: String; same code as c_script
bounds_2 = Bounds(Numbers=c_script_2.A)
construct_domain_2 = ConstructDomain(DomainStart=0, DomainEnd=Slider(6, range=0..1000))
remap_numbers_2 = RemapNumbers(Value=c_script_2.A, Source=bounds_2, Target=construct_domain_2)  # -> Mapped, Clipped

# ---- group: Precipitation
list_item_5 = ListItem(List=read_excel_sheet.Rows, Index=Slider(4, range=0..100), Wrap=True)  # -> flatten(Item)
cull_index_5 = CullIndex(List=list_item_5, Indices=Slider(0, range=0..100), Wrap=True)
c_script_3 = CSharpScript(x=flatten(cull_index_5))  # -> out, A; inputs x: String; same code as c_script
bounds_3 = Bounds(Numbers=c_script_3.A)
construct_domain_3 = ConstructDomain(DomainStart=0, DomainEnd=Slider(1, range=0..1000))
remap_numbers_3 = RemapNumbers(Value=c_script_3.A, Source=bounds_3, Target=construct_domain_3)  # -> Mapped, Clipped

# ---- group: Projections
number_slider = Slider(0.001, range=0..1)

# ---- group: Projections / Cassini
cassini = CSharpScript(lat=radians, lon=radians_2)  # -> out, A; inputs lat: Double, lon: Double
# ---------- cassini: C# ----------
    A = CassiniProjection(lat, lon);
# ---------- cassini: C# additional code ----------
  public Point3d CassiniProjection(double lat, double lon)
  {

    var earthRadius = 6367;

    var x = earthRadius * Math.Asin(Math.Cos(lat) * Math.Sin(lon));
    var y = earthRadius * Math.Atan2(Math.Sin(lat), Math.Cos(lat) * Math.Cos(lon));
    var z = earthRadius * Math.Sin(lat);
    return new Point3d(x, y, 0);

  }
# ---------- end cassini ----------
multiplication = Multiplication(A=cassini.A, B=number_slider)

# ---- group: Projections / Spherical
spherical = CSharpScript(x=radians, y=radians_2)  # -> out, A; inputs x: Double, y: Double
# ---------- spherical: C# ----------
    A = convertSphericalToCartesian(x, y);
# ---------- spherical: C# additional code ----------
  public Point3d convertSphericalToCartesian(double lat, double lon)
  {

    var earthRadius = 6367;

    var x = earthRadius * Math.Cos(lat) * Math.Cos(lon);
    var y = earthRadius * Math.Cos(lat) * Math.Sin(lon);
    var z = earthRadius * Math.Sin(lat);
    return new Point3d(x, y, z);

  }
# ---------- end spherical ----------
multiplication_2 = Multiplication(A=spherical.A, B=number_slider)

# ---- group: DataViz / BoxesAndDisplacement
construct_point = ConstructPoint(XCoordinate=0, YCoordinate=0, ZCoordinate=0)
vector_2pt = Vector2Pt(PointA=construct_point, PointB=multiplication_2, Unitize=False)  # -> Vector, Length
amplitude = Amplitude(Vector=vector_2pt.Vector, Amplitude=remap_numbers_2.Mapped)
number = Number(expr("x*0.1", remap_numbers_2.Mapped))
vector_display = VectorDisplay(Anchor=construct_point, Vector=amplitude)
move = Move(Geometry=multiplication_2, Motion=amplitude)  # -> Geometry, Transform
center_box = CenterBox(Base=move.Geometry, X=number, Y=number, Z=number)

# ---- group: DataViz / ColourPoints
colour_rgb = ColourRGB(Alpha=255, Red=remap_numbers.Mapped, Green=0, Blue=0)
dot_display = DotDisplay(Point=multiplication, Colour=colour_rgb, Size=Slider(0.05, range=0..1))
